# Grasshopper definition ArchSegment_Connector.gh (Grasshopper 1.0.8)

# ---- group: RH_IN:ASC_nras
nr_as = Slider(8, range=4..32)

# ---- group: RH_IN:ASC_station
station = Slider(2, range=1..31)

# ----
asc_nras = GetNumber(nr_as, AtLeast=1, AtMost=1, Maximum=1.797693135e+308, Minimum=-1.797693135e+308, TreeAccess=False)
asc_station = GetNumber(station, AtLeast=1, AtMost=1, Maximum=1.797693135e+308, Minimum=-1.797693135e+308, TreeAccess=False)
asc_phi = GetNumber(Slider(26.474, range=0..90), AtLeast=1, AtMost=1, Maximum=1.797693135e+308, Minimum=-1.797693135e+308, TreeAccess=False)
py3 = Python3Script(nr_as=asc_nras, s=asc_station, phi_deg=asc_phi)  # -> angle, a
# ---------- py3: Python ----------
import math
phi = math.radians(phi_deg)
k = min(s, nr_as - s)
angle = -((math.pi - phi) / 2 + phi * k / nr_as)
print(angle)
a = s > (nr_as // 2)
print(a)
# ---------- end py3 ----------

# ---- group: RH_IN:ASC_width
thickness = Slider(1851, range=0..4000)

# ---- group: RH_IN:ASC_length
length = Slider(118, range=1..300)

# ---- group: RH_IN:ASC_height
height = Slider(140, range=1..300)

# ----
item = ListItem(List=py3.angle, Index=0, Wrap=True)
division = Division(A=asc_nras, B="2")
asc_height = GetNumber(height, AtLeast=1, AtMost=1, Maximum=1.797693135e+308, Minimum=-1.797693135e+308, TreeAccess=False)
asc_length = GetNumber(length, AtLeast=1, AtMost=1, Maximum=1.797693135e+308, Minimum=-1.797693135e+308, TreeAccess=False)
asc_width = GetNumber(thickness, AtLeast=1, AtMost=1, Maximum=1.797693135e+308, Minimum=-1.797693135e+308, TreeAccess=False)
equals = Equality(FirstNumber=division, SecondNumber=asc_station)  # -> Equality, Inequality
pt = ConstructPoint(XCoordinate=0, YCoordinate=0, ZCoordinate=0)
X = UnitX(Factor=1)
line = LineSDL(Start=pt, Direction=X, Length=asc_length)
end = EndPoints(Curve=line)  # -> Start, End
line_2 = LineSDL(Start=end.Start, Direction=X, Length="20")
line_3 = LineSDL(Start=end.End, Direction=X, Length="20")
rad = Radians(Degrees="225")
rad_2 = Radians(Degrees="-45")
rotate = Rotate(Geometry=line_2, Angle=rad, Plane=pt)  # -> Geometry, Transform
rotate_2 = Rotate(Geometry=line_3, Angle=rad_2, Plane=end.End)  # -> Geometry, Transform
end_2 = EndPoints(Curve=rotate_2.Geometry)  # -> Start, End
line_4 = LineSDL(Start=end_2.End, Direction=X, Length=asc_height)
rotate_3 = Rotate(Geometry=line_4, Angle=item, Plane=end_2.End)  # -> Geometry, Transform
end_3 = EndPoints(Curve=rotate_3.Geometry)  # -> Start, End
Z = UnitZ(Factor=1)
vec2pt = Vector2Pt(PointA=end_3.Start, PointB=end_3.End, Unitize=False)  # -> Vector, Length
end_4 = EndPoints(Curve=rotate.Geometry)  # -> Start, End
xprod = CrossProduct(VectorA=vec2pt.Vector, VectorB=Z, Unitize=asc_height)  # -> Vector, Length
pdecon = Deconstruct(Point=end_4.End)  # -> XComponent, YComponent, ZComponent
line_5 = LineSDL(Start=end_3.Start, Direction=xprod.Vector, Length=asc_height)
line_6 = LineSDL(Start=end_3.Start, Direction=xprod.Vector, Length="3000")
Y = UnitY(Factor=1)
end_5 = EndPoints(Curve=line_5)  # -> Start, End
line_7 = LineSDL(Start=end_4.End, Direction=Y, Length="-1000")
llx = LineLine(Line1=line_7, Line2=line_6)  # -> ParamA, ParamB, PointA, PointB
pdecon_2 = Deconstruct(Point=llx.PointA)  # -> XComponent, YComponent, ZComponent
pt_2 = ConstructPoint(XCoordinate=pdecon.XComponent, YCoordinate=pdecon_2.YComponent, ZCoordinate="0")
line_8 = LineSDL(Start=pt_2, Direction=X, Length=asc_height)
rotate_4 = Rotate(Geometry=line_8, Angle=item, Plane=pt_2)  # -> Geometry, Transform
end_6 = EndPoints(Curve=rotate_4.Geometry)  # -> Start, End
merge = Merge(Data1=end.Start, Data2=end.End, Data3=end_3.Start, Data4=end_3.End, Data5=end_6.End, Data6=end_6.Start, Data7=end_4.End)
flatten = FlattenTree(Tree=merge, Path="{0}")
pline = PolyLine(Vertices=flatten, Closed="True")
Z_2 = UnitZ(Factor=asc_width)
boundary = BoundarySurfaces(Edges=pline)
extr = Extrude(Base=boundary, Direction=Z_2)
xz = XZPlane(Origin=Point(0, 0, 0))
neg = Negative(Value=asc_width)
rad_3 = Radians(Degrees="180")
orient = Orient(Geometry=extr, Source=PlaneXY(0, 0, 0), Target=xz)  # -> Geometry, Transform
rotate_5 = Rotate(Geometry=orient.Geometry, Angle=rad_3, Plane=pt)  # -> Geometry, Transform
vec = VectorXYZ(XComponent="0", YComponent=neg, ZComponent="0")  # -> Vector, Length
move = Move(Geometry=rotate_5.Geometry, Motion=vec.Vector)  # -> Geometry, Transform
filter = StreamFilter(Gate=py3.a, Stream0=orient.Geometry, Stream1=move.Geometry)

# ---- group: RH_OUT:ASC_brep
brep = Brep(orient.Geometry)

# ----
debrep = DeconstructBrep(Brep=orient.Geometry)  # -> Faces, Edges, Vertices
item_2 = ListItem(List=debrep.Faces, Index="3", Wrap=True)
item_3 = ListItem(List=debrep.Faces, Index="5", Wrap=True)
item_4 = ListItem(List=debrep.Faces, Index="1", Wrap=True)
area = Area(Geometry=item_2)  # -> Area, Centroid
area_2 = Area(Geometry=item_3)  # -> Area, Centroid
srf = Surface(item_4)
srf_2 = Surface(item_3)
area_3 = Area(Geometry=item_4)  # -> Area, Centroid
pl_origin = PlaneOrigin(Base=srf_2, Origin=area_2.Centroid)
pl_origin_2 = PlaneOrigin(Base=item_2, Origin=area.Centroid)
pl_origin_3 = PlaneOrigin(Base=srf, Origin=area_3.Centroid)
rad_4 = Radians(Degrees="180")
prot = RotatePlane(Plane=pl_origin, Angle=rad_4)
rad_5 = Radians(Degrees="90")
pflip = FlipPlane(Plane=pl_origin_3, ReverseX=False, ReverseY=False, SwapAxes=True)
pflip_2 = FlipPlane(Plane=pl_origin_2, ReverseX=False, ReverseY=False, SwapAxes=True)
pflip_3 = FlipPlane(Plane=prot, ReverseX=False, ReverseY=False, SwapAxes=True)
prot_2 = RotatePlane(Plane=pflip, Angle=rad_5)
deplane = DeconstructPlane(Plane=pflip_3)  # -> Origin, XAxis, YAxis, ZAxis
pflip_4 = FlipPlane(Plane=pflip_2, ReverseX=False, ReverseY=False, SwapAxes=False)
deplane_2 = DeconstructPlane(Plane=pflip_4)  # -> Origin, XAxis, YAxis, ZAxis
rev = Reverse(Vector=deplane.XAxis)
rev_2 = Reverse(Vector=deplane_2.XAxis)
pl = ConstructPlane(Origin=deplane.Origin, XAxis=rev, YAxis=deplane.YAxis)
pl_2 = ConstructPlane(Origin=deplane_2.Origin, XAxis=rev_2, YAxis=deplane_2.YAxis)
filter_2 = StreamFilter(Gate=equals.Equality, Stream0=pflip_3, Stream1=pl)
filter_3 = StreamFilter(Gate=equals.Equality, Stream0=pflip_4, Stream1=pl_2)
rh_out_asc_interface1 = Plane(filter_3)
rh_out_asc_interface2 = Plane(filter_2)
rh_out_asc_interface3 = Plane(prot_2)
deplane_3 = DeconstructPlane(Plane=rh_out_asc_interface1)  # -> Origin, XAxis, YAxis, ZAxis
deplane_4 = DeconstructPlane(Plane=rh_out_asc_interface3)  # -> Origin, XAxis, YAxis, ZAxis
deplane_5 = DeconstructPlane(Plane=rh_out_asc_interface2)  # -> Origin, XAxis, YAxis, ZAxis
vdis = VectorDisplay(Anchor=deplane_3.Origin, Vector=deplane_3.ZAxis)
vdis_2 = VectorDisplay(Anchor=deplane_5.Origin, Vector=deplane_5.ZAxis)
vdis_3 = VectorDisplay(Anchor=deplane_4.Origin, Vector=deplane_4.ZAxis)
