# Grasshopper definition Girder.gh (Grasshopper 1.0.7)

xy = XYPlane(Origin=Point(0, 0, 0))
grd_length = GetNumber(
    Slider(10000, range=3000..10000),
    AtLeast=1,
    AtMost=1,
    Maximum=1.797693135e+308,
    Minimum=-1.797693135e+308,
    TreeAccess=False)
grd_offset1 = GetNumber(Slider(1000, range=1..1000), AtLeast=1, AtMost=1, Maximum=1.797693135e+308, Minimum=-1.797693135e+308, TreeAccess=False)
grd_height = GetNumber(Slider(500, range=100..500), AtLeast=1, AtMost=1, Maximum=1.797693135e+308, Minimum=-1.797693135e+308, TreeAccess=False)
grd_width = GetNumber(
    Slider(5000, range=1000..5000),
    AtLeast=1,
    AtMost=1,
    Maximum=1.797693135e+308,
    Minimum=-1.797693135e+308,
    TreeAccess=False)
grd_offset2 = GetNumber(Slider(709, range=1..1000), AtLeast=1, AtMost=1, Maximum=1.797693135e+308, Minimum=-1.797693135e+308, TreeAccess=False)
rad = Radians(Degrees=Slider(360, range=0..360))
prot = RotatePlane(Plane=xy, Angle=rad)
box = DomainBox(Base=xy, X=grd_length, Y=grd_width, Z=grd_height)
rh_out_grd_brep = Brep(box)
debrep = DeconstructBrep(Brep=box)  # -> Faces, Edges, Vertices
integer_division = IntegerDivision(A=grd_length, B=2)
integer_division_2 = IntegerDivision(A=grd_width, B=2)
item = ListItem(List=debrep.Faces, Index="4", Wrap=True)
item_2 = ListItem(List=debrep.Faces, Index="5", Wrap=True)
pt = ConstructPoint(XCoordinate=0, YCoordinate=grd_width, ZCoordinate=0)
item_3 = ListItem(List=debrep.Vertices, Index=4, Wrap=True)
deplane = DeconstructPlane(Plane=item)  # -> Origin, XAxis, YAxis, ZAxis
subtraction = Subtraction(A=integer_division, B=grd_offset1)
subtraction_2 = Subtraction(A=integer_division_2, B=grd_offset2)
Y = UnitY(Factor=subtraction_2)
neg = Negative(Value=Y)
area = Area(Geometry=item)  # -> Area, Centroid
move = Move(Geometry=item_3, Motion=pt)  # -> Geometry, Transform
multiplication = Multiplication(A=subtraction, B=deplane.YAxis)
neg_2 = Negative(Value=multiplication)
move_2 = Move(Geometry=area.Centroid, Motion=multiplication)  # -> Geometry, Transform
multiplication_2 = Multiplication(A=subtraction_2, B=deplane.XAxis)
move_3 = Move(Geometry=area.Centroid, Motion=neg_2)  # -> Geometry, Transform
pl_origin = PlaneOrigin(Base=item_2, Origin=move.Geometry)
pl_origin_2 = PlaneOrigin(Base=item_2, Origin=item_3)
pl_origin_3 = PlaneOrigin(Base=item, Origin=move_2.Geometry)
pl_origin_4 = PlaneOrigin(Base=item, Origin=move_3.Geometry)
neg_3 = Negative(Value=multiplication_2)
pflip = FlipPlane(Plane=pl_origin_2, ReverseX=False, ReverseY=False, SwapAxes=True)
pflip_2 = FlipPlane(Plane=pl_origin, ReverseX=False, ReverseY=False, SwapAxes=True)
prot_2 = RotatePlane(Plane=pl_origin_4, Angle=1.570796327)
prot_3 = RotatePlane(Plane=pl_origin_3, Angle=-1.570796327)
move_4 = Move(Geometry=prot_3, Motion=multiplication_2)  # -> Geometry, Transform
move_5 = Move(Geometry=prot_3, Motion=neg_3)  # -> Geometry, Transform
move_6 = Move(Geometry=prot_2, Motion=multiplication_2)  # -> Geometry, Transform
move_7 = Move(Geometry=prot_2, Motion=neg_3)  # -> Geometry, Transform
rh_out_grd_sidewalk_interface1 = Plane(pflip)
rh_out_grd_sidewalk_interface2 = Plane(pflip_2)
rh_out_grd_interface2 = Plane(prot_3)
rh_out_grd_interface3 = Plane(move_5.Geometry)
rh_out_grd_interface1 = Plane(move_4.Geometry)
rh_out_grd_interface5 = Plane(prot_2)
rh_out_grd_interface6 = Plane(move_6.Geometry)
rh_out_grd_interface4 = Plane(move_7.Geometry)
deplane_2 = DeconstructPlane(Plane=rh_out_grd_sidewalk_interface2)  # -> Origin, XAxis, YAxis, ZAxis
deplane_3 = DeconstructPlane(Plane=rh_out_grd_interface2)  # -> Origin, XAxis, YAxis, ZAxis
deplane_4 = DeconstructPlane(Plane=rh_out_grd_sidewalk_interface1)  # -> Origin, XAxis, YAxis, ZAxis
deplane_5 = DeconstructPlane(Plane=rh_out_grd_interface3)  # -> Origin, XAxis, YAxis, ZAxis
deplane_6 = DeconstructPlane(Plane=rh_out_grd_interface1)  # -> Origin, XAxis, YAxis, ZAxis
deplane_7 = DeconstructPlane(Plane=rh_out_grd_interface5)  # -> Origin, XAxis, YAxis, ZAxis
deplane_8 = DeconstructPlane(Plane=rh_out_grd_interface6)  # -> Origin, XAxis, YAxis, ZAxis
deplane_9 = DeconstructPlane(Plane=rh_out_grd_interface4)  # -> Origin, XAxis, YAxis, ZAxis
vdis = VectorDisplay(Anchor=deplane_5.Origin, Vector=deplane_5.XAxis)
vdis_2 = VectorDisplay(Anchor=deplane_5.Origin, Vector=deplane_5.ZAxis)
vdis_3 = VectorDisplay(Anchor=deplane_6.Origin, Vector=deplane_6.ZAxis)
vdis_4 = VectorDisplay(Anchor=deplane_2.Origin, Vector=deplane_2.ZAxis)
vdis_5 = VectorDisplay(Anchor=deplane_4.Origin, Vector=deplane_4.ZAxis)
vdis_6 = VectorDisplay(Anchor=deplane_3.Origin, Vector=deplane_3.XAxis)
vdis_7 = VectorDisplay(Anchor=deplane_3.Origin, Vector=deplane_3.ZAxis)
vdis_8 = VectorDisplay(Anchor=deplane_6.Origin, Vector=deplane_6.XAxis)
vdis_9 = VectorDisplay(Anchor=deplane_8.Origin, Vector=deplane_8.XAxis)
vdis_10 = VectorDisplay(Anchor=deplane_8.Origin, Vector=deplane_8.ZAxis)
vdis_11 = VectorDisplay(Anchor=deplane_7.Origin, Vector=deplane_7.ZAxis)
vdis_12 = VectorDisplay(Anchor=deplane_7.Origin, Vector=deplane_7.XAxis)
vdis_13 = VectorDisplay(Anchor=deplane_9.Origin, Vector=deplane_9.ZAxis)
vdis_14 = VectorDisplay(Anchor=deplane_9.Origin, Vector=deplane_9.XAxis)
