# Grasshopper definition abutment_middle_d2.gh (Grasshopper 1.0.7)

abt_md_length = GetNumber(Slider(2192, range=0..3000), AtLeast=1, AtMost=1, Maximum=1.797693135e+308, Minimum=-1.797693135e+308, TreeAccess=False)
abt_md_thickness = GetNumber(Slider(372, range=0..3000), AtLeast=1, AtMost=1, Maximum=1.797693135e+308, Minimum=-1.797693135e+308, TreeAccess=False)
abt_md_height = GetNumber(Slider(1470, range=0..3000), AtLeast=1, AtMost=1, Maximum=1.797693135e+308, Minimum=-1.797693135e+308, TreeAccess=False)
box = DomainBox(Base=PlaneXY(0, 0, 0), X=abt_md_length, Y=abt_md_thickness, Z=abt_md_height)
division = Division(A=abt_md_thickness, B=2)
division_2 = Division(A=abt_md_length, B=2)

# ---- group: RH_OUT:ABT_MD_brep
brep = Brep(box)

# ----
debrep = DeconstructBrep(Brep=box)  # -> Faces, Edges, Vertices
item = ListItem(List=debrep.Faces, Index=4, Wrap=True)
area = Area(Geometry=item)  # -> Area, Centroid
item_2 = ListItem(List=debrep.Faces, Index=0, Wrap=True)
subtraction = Subtraction(A=division_2, B=division)
area_2 = Area(Geometry=item_2)  # -> Area, Centroid
pl_origin = PlaneOrigin(Base=item, Origin=area.Centroid)
pflip = FlipPlane(Plane=pl_origin, ReverseX=False, ReverseY=False, SwapAxes=True)
pl_origin_2 = PlaneOrigin(Base=item_2, Origin=area_2.Centroid)
deplane = DeconstructPlane(Plane=pl_origin_2)  # -> Origin, XAxis, YAxis, ZAxis
multiplication = Multiplication(A=deplane.YAxis, B=subtraction)
vec = VectorXYZ(XComponent=multiplication, YComponent=0, ZComponent=0)  # -> Vector, Length

# ---- group: RH_OUT:ABT_SD_interface3
pln = Plane(pflip)

# ----
neg = Negative(Value=vec.Vector)
move = Move(Geometry=pl_origin_2, Motion=vec.Vector)  # -> Geometry, Transform
deplane_2 = DeconstructPlane(Plane=pln)  # -> Origin, XAxis, YAxis, ZAxis
move_2 = Move(Geometry=pl_origin_2, Motion=neg)  # -> Geometry, Transform
pflip_2 = FlipPlane(Plane=move.Geometry, ReverseX=False, ReverseY=False, SwapAxes=True)
pflip_3 = FlipPlane(Plane=move_2.Geometry, ReverseX=False, ReverseY=False, SwapAxes=True)
vdis = VectorDisplay(Anchor=deplane_2.Origin, Vector=deplane_2.XAxis)
vdis_2 = VectorDisplay(Anchor=deplane_2.Origin, Vector=deplane_2.ZAxis)

# ---- group: RH_OUT:ABT_SD_interface1
pln_2 = Plane(pflip_2)

# ---- group: RH_OUT:ABT_SD_interface2
pln_3 = Plane(pflip_3)

# ----
deplane_3 = DeconstructPlane(Plane=pln_2)  # -> Origin, XAxis, YAxis, ZAxis
deplane_4 = DeconstructPlane(Plane=pln_3)  # -> Origin, XAxis, YAxis, ZAxis
vdis_3 = VectorDisplay(Anchor=deplane_3.Origin, Vector=deplane_3.XAxis)
vdis_4 = VectorDisplay(Anchor=deplane_3.Origin, Vector=deplane_3.ZAxis)
vdis_5 = VectorDisplay(Anchor=deplane_4.Origin, Vector=deplane_4.XAxis)
vdis_6 = VectorDisplay(Anchor=deplane_4.Origin, Vector=deplane_4.ZAxis)
