# Grasshopper definition abutment_side_d2.gh (Grasshopper 1.0.7)

number_slider = Slider(2061, range=0..5000)
abt_sd_middleheight = GetNumber(Slider(1550, range=0..4000), AtLeast=1, AtMost=1, Maximum=1.797693135e+308, Minimum=-1.797693135e+308, TreeAccess=False)
abt_sd_angle = GetNumber(Slider(30, range=0..90), AtLeast=1, AtMost=1, Maximum=1.797693135e+308, Minimum=-1.797693135e+308, TreeAccess=False)
rad = Radians(Degrees=abt_sd_angle)
tan = Tangent(Value=rad)
xy = XYPlane(Origin=Point(0, 0, 0))
abt_sd_length = GetNumber(
    Slider(1771, range=100..3000),
    AtLeast=1,
    AtMost=1,
    Maximum=1.797693135e+308,
    Minimum=-1.797693135e+308,
    TreeAccess=False)
abt_sd_height = GetNumber(number_slider, AtLeast=1, AtMost=1, Maximum=1.797693135e+308, Minimum=-1.797693135e+308, TreeAccess=False)
abt_sd_thickness = GetNumber(Slider(698, range=0..1000), AtLeast=1, AtMost=1, Maximum=1.797693135e+308, Minimum=-1.797693135e+308, TreeAccess=False)
multiplication = Multiplication(A=number_slider, B=tan)
addition = Addition(A=abt_sd_length, B=multiplication)
rectangle = Rectangle(Plane=xy, XSize=abt_sd_thickness, YSize=abt_sd_length, Radius=0)  # -> Rectangle, Length
division = Division(A=addition, B=abt_sd_length)
division_2 = Division(A=abt_sd_middleheight, B=2)
scale_nu = ScaleNU(Geometry=rectangle.Rectangle, Plane=PlaneXY(0, 0, 0), ScaleX=1, ScaleY=division, ScaleZ=1)  # -> Geometry, Transform
vec = VectorXYZ(XComponent=0, YComponent=0, ZComponent=abt_sd_height)  # -> Vector, Length
move = Move(Geometry=scale_nu.Geometry, Motion=vec.Vector)  # -> Geometry, Transform
merge = Merge(Data1=rectangle.Rectangle, Data2=move.Geometry)
loft = Loft(Curves=merge, Options={Adjust=False, Closed=False, LoftEnds=0, LoftSimp=0, LoftType=0, Rebuild=10, Refit=0.01})
rad_2 = Radians(Degrees=Slider(0, range=0..360))
cap = CapHoles(Brep=loft)
rotate = Rotate(Geometry=cap, Angle=rad_2, Plane=PlaneXY(0, 0, 0))  # -> Geometry, Transform

# ---- group: RH_OUT:ABT_SD_brep
brep = Brep(cap)

# ----
debrep = DeconstructBrep(Brep=cap)  # -> Faces, Edges, Vertices
item = ListItem(List=debrep.Faces, Index=1, Wrap=True)
item_2 = ListItem(List=debrep.Faces, Index=5, Wrap=True)
area = Area(Geometry=item)  # -> Area, Centroid
devec = DeconstructVector(Vector=area.Centroid)  # -> XComponent, YComponent, ZComponent
area_2 = Area(Geometry=item_2)  # -> Area, Centroid
pt = ConstructPoint(XCoordinate=devec.XComponent, YCoordinate=devec.YComponent, ZCoordinate=division_2)
pl_origin = PlaneOrigin(Base=item_2, Origin=area_2.Centroid)
pl_origin_2 = PlaneOrigin(Base=item, Origin=pt)
pflip = FlipPlane(Plane=pl_origin_2, ReverseX=False, ReverseY=False, SwapAxes=True)

# ---- group: RH_OUT:ABT_SD_interface1
pln = Plane(pl_origin)

# ----
prot = RotatePlane(Plane=pflip, Angle=4.71238898)
deplane = DeconstructPlane(Plane=pln)  # -> Origin, XAxis, YAxis, ZAxis

# ---- group: RH_OUT:ABT_SD_interface2
pln_2 = Plane(prot)

# ----
vdis = VectorDisplay(Anchor=deplane.Origin, Vector=deplane.XAxis)
deplane_2 = DeconstructPlane(Plane=pln_2)  # -> Origin, XAxis, YAxis, ZAxis
vdis_2 = VectorDisplay(Anchor=deplane.Origin, Vector=deplane.ZAxis)
vdis_3 = VectorDisplay(Anchor=deplane_2.Origin, Vector=deplane_2.XAxis)
vdis_4 = VectorDisplay(Anchor=deplane_2.Origin, Vector=deplane_2.ZAxis)
