# Grasshopper definition foundation_d2.gh (Grasshopper 1.0.7)

get_number = GetNumber(Slider(317, range=0..5000), AtLeast=1, AtMost=1, Maximum=1.797693135e+308, Minimum=-1.797693135e+308, TreeAccess=False)
get_number_2 = GetNumber(Slider(1270, range=0..5000), AtLeast=1, AtMost=1, Maximum=1.797693135e+308, Minimum=-1.797693135e+308, TreeAccess=False)
get_number_3 = GetNumber(Slider(553, range=0..5000), AtLeast=1, AtMost=1, Maximum=1.797693135e+308, Minimum=-1.797693135e+308, TreeAccess=False)
get_number_4 = GetNumber(Slider(2039, range=0..5000), AtLeast=1, AtMost=1, Maximum=1.797693135e+308, Minimum=-1.797693135e+308, TreeAccess=False)
multiplication = Multiplication(A=get_number, B=2)
subtraction = Subtraction(A=get_number_4, B=multiplication)
division = Division(A=get_number, B=2)
division_2 = Division(A=get_number, B=2)
rectangle = Rectangle(Plane=PlaneXY(0, 0, 0), XSize=get_number_4, YSize=get_number_2, Radius=0)  # -> Rectangle, Length
rectangle_2 = Rectangle(Plane=PlaneXY(0, 0, 0), XSize=subtraction, YSize=get_number_2, Radius=0)  # -> Rectangle, Length
Y = UnitY(Factor=get_number)
move = Move(Geometry=rectangle_2.Rectangle, Motion=Y)  # -> Geometry, Transform
X = UnitX(Factor=get_number)
move_2 = Move(Geometry=move.Geometry, Motion=X)  # -> Geometry, Transform
Z = UnitZ(Factor=get_number_3)
rdiff = RegionDifference(CurvesA=rectangle.Rectangle, CurvesB=move_2.Geometry)
extr = Extrude(Base=rdiff, Direction=Z)
division_3 = Division(A=get_number_4, B=2)
cap = CapHoles(Brep=extr)
brep = Brep(cap)
debrep = DeconstructBrep(Brep=cap)  # -> Faces, Edges, Vertices
item = ListItem(List=debrep.Faces, Index=8, Wrap=True)
vec = VectorXYZ(XComponent=division_3, YComponent=division_2, ZComponent=Z)  # -> Vector, Length
pl_origin = PlaneOrigin(Base=item, Origin=vec.Vector)
prot = RotatePlane(Plane=pl_origin, Angle=1.570796327)
pln = Plane(prot)
deplane = DeconstructPlane(Plane=pln)  # -> Origin, XAxis, YAxis, ZAxis
vdis = VectorDisplay(Anchor=deplane.Origin, Vector=deplane.XAxis)
vdis_2 = VectorDisplay(Anchor=deplane.Origin, Vector=deplane.ZAxis)
