# Grasshopper definition t_girder_d2.gh (Grasshopper 1.0.7)

interface_offset = Slider(1000, range=1..1000)
nr_t = Slider(3, range=2..3)
t_height = Slider(842, range=300..1000)
thickness = Slider(370, range=300..1000)
t_thickness = Slider(554, range=300..1000)
t_offset = Slider(899, range=10..3000)
wdth = Slider(6300, range=1000..12000)

# ---- group: RH_IN:D2_GRD_nr_t
d2_grd_nr_t = GetNumber(nr_t, AtLeast=1, AtMost=1, Maximum=1.797693135e+308, Minimum=-1.797693135e+308, TreeAccess=False)

# ---- group: RH_IN:D2_GRD_iface_offset
d2_grd_iface_offset = GetNumber(interface_offset, AtLeast=1, AtMost=1, Maximum=1.797693135e+308, Minimum=-1.797693135e+308, TreeAccess=False)

# ---- group: RH_IN:D2_GRD_t_thickness
d2_grd_t_thickness = GetNumber(t_thickness, AtLeast=1, AtMost=1, Maximum=1.797693135e+308, Minimum=-1.797693135e+308, TreeAccess=False)

# ---- group: RH_IN:D2_GRD_t_offset
d2_grd_t_offset = GetNumber(t_offset, AtLeast=1, AtMost=1, Maximum=1.797693135e+308, Minimum=-1.797693135e+308, TreeAccess=False)

# ---- group: RH_IN:D2_GRD_t_height
d2_grd_t_height = GetNumber(t_height, AtLeast=1, AtMost=1, Maximum=1.797693135e+308, Minimum=-1.797693135e+308, TreeAccess=False)

# ---- group: RH_IN:D2_GRD_thickness
d2_grd_thickness = GetNumber(thickness, AtLeast=1, AtMost=1, Maximum=1.797693135e+308, Minimum=-1.797693135e+308, TreeAccess=False)

# ---- group: RH_IN:D2_GRD_width
d2_grd_width = GetNumber(wdth, AtLeast=1, AtMost=1, Maximum=1.797693135e+308, Minimum=-1.797693135e+308, TreeAccess=False)

# ---- group: RH_IN:D2_GRD_length
d2_grd_length = GetNumber(
    Slider(11963, range=10000..25000),
    AtLeast=1,
    AtMost=1,
    Maximum=1.797693135e+308,
    Minimum=-1.797693135e+308,
    TreeAccess=False)

# ----
xz = XZPlane(Origin=Point(0, 0, 0))
subtraction = Subtraction(A=d2_grd_width, B=d2_grd_t_offset)
neg = Negative(Value=d2_grd_t_height)
equals = Equality(FirstNumber=d2_grd_nr_t, SecondNumber=3)  # -> Equality, Inequality
subtraction_2 = Subtraction(A=d2_grd_width, B=d2_grd_t_thickness)
subtraction_3 = Subtraction(A=subtraction, B=d2_grd_t_thickness)
rectangle = Rectangle(Plane=xz, XSize=d2_grd_width, YSize=d2_grd_thickness, Radius=0)  # -> Rectangle, Length
rectangle_2 = Rectangle(Plane=xz, XSize=d2_grd_t_thickness, YSize=neg, Radius=0)  # -> Rectangle, Length
division = Division(A=subtraction_2, B=2)
X = UnitX(Factor=d2_grd_t_offset)
X_2 = UnitX(Factor=d2_grd_t_offset)
X_3 = UnitX(Factor=subtraction_3)
X_4 = UnitX(Factor=division)
move = Move(Geometry=rectangle_2.Rectangle, Motion=X)  # -> Geometry, Transform
move_2 = Move(Geometry=rectangle_2.Rectangle, Motion=X_3)  # -> Geometry, Transform
move_3 = Move(Geometry=rectangle_2.Rectangle, Motion=X_4)  # -> Geometry, Transform
filter = StreamFilter(Gate=equals.Equality, Stream1=move_3.Geometry)
merge = Merge(Data1=rectangle.Rectangle, Data2=move.Geometry, Data3=move_2.Geometry, Data4=filter)
Y = UnitY(Factor=d2_grd_length)
runion = RegionUnion(Curves=merge)
fillet = FilletDistance(Curve=runion, Distance=40)
explode = Explode(Curve=fillet, Recursive=True)  # -> Segments, Vertices
pline = PolyLine(Vertices=explode.Vertices, Closed=False)
extr = Extrude(Base=pline, Direction=Y)
rad = Radians(Degrees=Slider(0, range=0..360))
vec = VectorXYZ(XComponent=Slider(0, range=0..1000), YComponent=Slider(0, range=0..1000), ZComponent=0)  # -> Vector, Length
cap = CapHoles(Brep=extr)
rotate = Rotate(Geometry=cap, Angle=rad, Plane=PlaneXY(0, 0, 0))  # -> Geometry, Transform
move_4 = Move(Geometry=rotate.Geometry, Motion=vec.Vector)  # -> Geometry, Transform
debrep = DeconstructBrep(Brep=cap)  # -> Faces, Edges, Vertices

# ---- group: RH_OUT:D2_GRD_brep
brep = Brep(cap)

# ----
division_2 = Division(A=d2_grd_length, B=2)
item = ListItem(List=debrep.Faces, Index=14, Wrap=True)
deplane = DeconstructPlane(Plane=item)  # -> Origin, XAxis, YAxis, ZAxis
subtraction_4 = Subtraction(A=division_2, B=d2_grd_iface_offset)
area = Area(Geometry=item)  # -> Area, Centroid
Y_2 = UnitY(Factor=subtraction_4)
multiplication = Multiplication(A=deplane.YAxis, B=subtraction_4)
neg_2 = Negative(Value=multiplication)
pl_origin = PlaneOrigin(Base=item, Origin=area.Centroid)
move_5 = Move(Geometry=pl_origin, Motion=multiplication)  # -> Geometry, Transform
move_6 = Move(Geometry=pl_origin, Motion=neg_2)  # -> Geometry, Transform
prot = RotatePlane(Plane=move_5.Geometry, Angle=-1.570796327)
prot_2 = RotatePlane(Plane=move_6.Geometry, Angle=1.570796327)

# ---- group: RH_OUT:D2_GRD_interface2
pln = Plane(prot)

# ---- group: RH_OUT:D2_GRD_interface1
pln_2 = Plane(prot_2)

# ----
deplane_2 = DeconstructPlane(Plane=pln)  # -> Origin, XAxis, YAxis, ZAxis
deplane_3 = DeconstructPlane(Plane=pln_2)  # -> Origin, XAxis, YAxis, ZAxis
vdis = VectorDisplay(Anchor=deplane_2.Origin, Vector=deplane_2.ZAxis)
vdis_2 = VectorDisplay(Anchor=deplane_2.Origin, Vector=deplane_2.XAxis)
vdis_3 = VectorDisplay(Anchor=deplane_3.Origin, Vector=deplane_3.ZAxis)
vdis_4 = VectorDisplay(Anchor=deplane_3.Origin, Vector=deplane_3.XAxis)
