# Grasshopper definition t_girder_module_d3.gh (Grasshopper 1.0.7)

interface_offset = Slider(1000, range=1..1000)
nr_t = Slider(3, range=2..3)
t_height = Slider(842, range=300..1000)
thickness = Slider(370, range=300..1000)
t_thickness = Slider(554, range=300..1000)
t_offset = Slider(899, range=10..3000)
wdth = Slider(6300, range=1000..12000)
d3_grd_nr_t = GetNumber(nr_t, AtLeast=1, AtMost=1, Maximum=1.797693135e+308, Minimum=-1.797693135e+308, TreeAccess=False)
d3_grd_iface_offset = GetNumber(interface_offset, AtLeast=1, AtMost=1, Maximum=1.797693135e+308, Minimum=-1.797693135e+308, TreeAccess=False)
d3_grd_t_thickness = GetNumber(t_thickness, AtLeast=1, AtMost=1, Maximum=1.797693135e+308, Minimum=-1.797693135e+308, TreeAccess=False)
d3_grd_t_offset = GetNumber(t_offset, AtLeast=1, AtMost=1, Maximum=1.797693135e+308, Minimum=-1.797693135e+308, TreeAccess=False)
d3_grd_t_height = GetNumber(t_height, AtLeast=1, AtMost=1, Maximum=1.797693135e+308, Minimum=-1.797693135e+308, TreeAccess=False)
d3_grd_thickness = GetNumber(thickness, AtLeast=1, AtMost=1, Maximum=1.797693135e+308, Minimum=-1.797693135e+308, TreeAccess=False)
d3_grd_length = GetNumber(
    Slider(11963, range=10000..25000),
    AtLeast=1,
    AtMost=1,
    Maximum=1.797693135e+308,
    Minimum=-1.797693135e+308,
    TreeAccess=False)
d3_grd_width = GetNumber(wdth, AtLeast=1, AtMost=1, Maximum=1.797693135e+308, Minimum=-1.797693135e+308, TreeAccess=False)
xz = XZPlane(Origin=Point(0, 0, 0))
subtraction = Subtraction(A=d3_grd_width, B=d3_grd_t_offset)
neg = Negative(Value=d3_grd_t_height)
equals = Equality(FirstNumber=d3_grd_nr_t, SecondNumber=3)  # -> Equality, Inequality
subtraction_2 = Subtraction(A=d3_grd_width, B=d3_grd_t_thickness)
subtraction_3 = Subtraction(A=subtraction, B=d3_grd_t_thickness)
rectangle = Rectangle(Plane=xz, XSize=d3_grd_width, YSize=d3_grd_thickness, Radius=0)  # -> Rectangle, Length
rectangle_2 = Rectangle(Plane=xz, XSize=d3_grd_t_thickness, YSize=neg, Radius=0)  # -> Rectangle, Length
division = Division(A=subtraction_2, B=2)
X = UnitX(Factor=d3_grd_t_offset)
X_2 = UnitX(Factor=d3_grd_t_offset)
X_3 = UnitX(Factor=subtraction_3)
X_4 = UnitX(Factor=division)
move = Move(Geometry=rectangle_2.Rectangle, Motion=X)  # -> Geometry, Transform
move_2 = Move(Geometry=rectangle_2.Rectangle, Motion=X_3)  # -> Geometry, Transform
move_3 = Move(Geometry=rectangle_2.Rectangle, Motion=X_4)  # -> Geometry, Transform
filter = StreamFilter(Gate=equals.Equality, Stream1=move_3.Geometry)
merge = Merge(Data1=rectangle.Rectangle, Data2=move.Geometry, Data3=move_2.Geometry, Data4=filter)
Y = UnitY(Factor=d3_grd_length)
runion = RegionUnion(Curves=merge)
fillet = FilletDistance(Curve=runion, Distance=40)
explode = Explode(Curve=fillet, Recursive=True)  # -> Segments, Vertices
subtraction_4 = Subtraction(A=d3_grd_thickness, B=30)
pline = PolyLine(Vertices=explode.Vertices, Closed=False)
Z = UnitZ(Factor=subtraction_4)
extr = Extrude(Base=pline, Direction=Y)
rad = Radians(Degrees=Slider(0, range=0..360))
vec = VectorXYZ(XComponent=0, YComponent=0, ZComponent=Z)  # -> Vector, Length
vec_2 = VectorXYZ(XComponent=Slider(0, range=0..1000), YComponent=Slider(0, range=0..1000), ZComponent=0)  # -> Vector, Length
cap = CapHoles(Brep=extr)
rotate = Rotate(Geometry=cap, Angle=rad, Plane=PlaneXY(0, 0, 0))  # -> Geometry, Transform
move_4 = Move(Geometry=rotate.Geometry, Motion=vec_2.Vector)  # -> Geometry, Transform
debrep = DeconstructBrep(Brep=cap)  # -> Faces, Edges, Vertices

# ---- group: RH_OUT:D2_GRD_brep
brep = Brep(cap)

# ----
division_2 = Division(A=d3_grd_length, B=2)
item = ListItem(List=debrep.Faces, Index=14, Wrap=True)
item_2 = ListItem(List=debrep.Faces, Index=32, Wrap=True)
item_3 = ListItem(List=debrep.Faces, Index=33, Wrap=True)
deplane = DeconstructPlane(Plane=item)  # -> Origin, XAxis, YAxis, ZAxis
subtraction_5 = Subtraction(A=division_2, B=d3_grd_iface_offset)
area = Area(Geometry=item)  # -> Area, Centroid
area_2 = Area(Geometry=item_2)  # -> Area, Centroid
area_3 = Area(Geometry=item_3)  # -> Area, Centroid
xz_2 = XZPlane(Origin=Point(0, 0, 0))
xz_3 = XZPlane(Origin=Point(0, 0, 0))
Y_2 = UnitY(Factor=subtraction_5)
multiplication = Multiplication(A=deplane.YAxis, B=subtraction_5)
devec = DeconstructVector(Vector=area_2.Centroid)  # -> XComponent, YComponent, ZComponent
neg_2 = Negative(Value=multiplication)
pl_origin = PlaneOrigin(Base=item, Origin=area.Centroid)
devec_2 = DeconstructVector(Vector=area_3.Centroid)  # -> XComponent, YComponent, ZComponent
vec_3 = VectorXYZ(XComponent=devec.XComponent, YComponent=devec.YComponent, ZComponent=0)  # -> Vector, Length
vec_4 = VectorXYZ(XComponent=devec_2.XComponent, YComponent=devec_2.YComponent, ZComponent=0)  # -> Vector, Length
move_5 = Move(Geometry=pl_origin, Motion=multiplication)  # -> Geometry, Transform
move_6 = Move(Geometry=pl_origin, Motion=neg_2)  # -> Geometry, Transform
move_7 = Move(Geometry=vec_3.Vector, Motion=vec.Vector)  # -> Geometry, Transform
pl_origin_2 = PlaneOrigin(Base=xz_2, Origin=move_7.Geometry)
move_8 = Move(Geometry=vec_4.Vector, Motion=vec.Vector)  # -> Geometry, Transform
pl_origin_3 = PlaneOrigin(Base=xz_3, Origin=move_8.Geometry)
prot = RotatePlane(Plane=move_5.Geometry, Angle=-1.570796327)
prot_2 = RotatePlane(Plane=move_6.Geometry, Angle=1.570796327)

# ---- group: RH_OUT:D2_GRD_interface2
pln = Plane(prot)

# ---- group: RH_OUT:D2_GRD_interface1
pln_2 = Plane(prot_2)

# ---- group: RH_OUT:D2_GRD_interface3
pln_3 = Plane(pl_origin_2)

# ---- group: RH_OUT:D2_GRD_interface4
pln_4 = Plane(pl_origin_3)

# ----
deplane_2 = DeconstructPlane(Plane=pln)  # -> Origin, XAxis, YAxis, ZAxis
deplane_3 = DeconstructPlane(Plane=pln_2)  # -> Origin, XAxis, YAxis, ZAxis
deplane_4 = DeconstructPlane(Plane=pln_3)  # -> Origin, XAxis, YAxis, ZAxis
deplane_5 = DeconstructPlane(Plane=pln_4)  # -> Origin, XAxis, YAxis, ZAxis
vdis = VectorDisplay(Anchor=deplane_2.Origin, Vector=deplane_2.ZAxis)
vdis_2 = VectorDisplay(Anchor=deplane_2.Origin, Vector=deplane_2.XAxis)
vdis_3 = VectorDisplay(Anchor=deplane_3.Origin, Vector=deplane_3.ZAxis)
vdis_4 = VectorDisplay(Anchor=deplane_3.Origin, Vector=deplane_3.XAxis)
vdis_5 = VectorDisplay(Anchor=deplane_4.Origin, Vector=deplane_4.ZAxis)
vdis_6 = VectorDisplay(Anchor=deplane_4.Origin, Vector=deplane_4.XAxis)
vdis_7 = VectorDisplay(Anchor=deplane_5.Origin, Vector=deplane_5.ZAxis)
vdis_8 = VectorDisplay(Anchor=deplane_5.Origin, Vector=deplane_5.XAxis)
